# Dynamo graph Insert Values.dyn (Dynamo 1.3.1.1736)

# group: Set Category
categories = Categories("DuctCurves")

python_string_from_object = Python(IN[0]=categories)
# ---------- python_string_from_object.python (9 lines) ----------
import clr
clr.AddReference('ProtoGeometry')
from Autodesk.DesignScript.Geometry import *
#The inputs to this node will be stored as a list in the IN variables.
category = IN[0]


#Assign your output to the OUT variable.
OUT = '"' + str(category) + '"'
# ----------------------------------------

# group: Get all elements and their parameters
all_elements_of_category = ElementsOfCategory(categories)
parameters = Element.Parameters(all_elements_of_category)

# group: Insert Element Id's to beginning of lists
id = Element.Id(all_elements_of_category)
python_script = Python(IN[0]=id)
# ---------- python_script.python (11 lines) ----------
import clr
clr.AddReference('ProtoGeometry')
from Autodesk.DesignScript.Geometry import *
#The inputs to this node will be stored as a list in the IN variables.
listIn = IN[0]

for index, i in enumerate(listIn):
	listIn[index] = "Element Id : " + str(i)

#Assign your output to the OUT variable.
OUT = listIn
# ----------------------------------------
python_script_2 = Python(IN[0]=parameters, IN[1]=python_script)
# ---------- python_script_2.python (12 lines) ----------
import clr
clr.AddReference('ProtoGeometry')
from Autodesk.DesignScript.Geometry import *
#The inputs to this node will be stored as a list in the IN variables.
mainList = IN[0]
elementIds = IN[1]

for ele_a, ele_b in zip(mainList, elementIds):
    ele_a.insert(0, ele_b)

#Assign your output to the OUT variable.
OUT = mainList
# ----------------------------------------
watch = Watch(python_script_2)

code_block = CodeBlock { 1; }
flatten = List.Flatten(list=python_script_2, amt=code_block)
watch_2 = Watch(flatten)

# group: Get all elements and their parameters
all_elements_of_category_2 = ElementsOfCategory(categories)
parameters_2 = Element.Parameters(all_elements_of_category_2)
watch_3 = Watch(parameters_2)

# group: Get parameter names (keys)
name = Parameter.Name(watch_3)
watch_4 = Watch(name)

# group: Get parameter values (values)
getParameterValueByName = Element.GetParameterValueByName(element=all_elements_of_category, parameterName=watch_4)
watch_5 = Watch(getParameterValueByName)

# group: Create list of Element Ids with sublists of parameters
python_create_sublists = Python(IN[2]=python_script_2)  # unwired: IN[0], IN[1]
# ---------- python_create_sublists.python (14 lines) ----------
import clr
clr.AddReference('ProtoGeometry')
from Autodesk.DesignScript.Geometry import *
#The inputs to this node will be stored as a list in the IN variables.
#The inputs to this node will be stored as a list in the IN variables.
tableName = IN[0]
listOfFields = IN[1]
listOfValues = IN[2]

# Create dictionary items with first value as key
dictionary = {e[0].split(" : ")[1] : e[1:] for e in listOfValues}

#Assign your output to the OUT variable.
OUT = dictionary.items()
# ----------------------------------------
watch_6 = Watch(python_create_sublists)

python_script_3 = Python(IN[0]=watch_6)
# ---------- python_script_3.python (21 lines) ----------
import clr
clr.AddReference('ProtoGeometry')
from Autodesk.DesignScript.Geometry import *
#The inputs to this node will be stored as a list in the IN variables.
listIn = IN

#for i in listIn:
#	i[0][0][1].split(" : ")[1]

# Output dictionary with Element Id as key
elementDict = dict(zip(listIn[0][0][0],listIn[0][0][1]))
#OUT = elementDict.items()

# Drill down to first element
OUT = listIn[0][0]

# Drill down to first element Id
#OUT = listIn[0][0][0]

# Drill down to first list of parameters 
#OUT = listIn[0][0][1]
# ----------------------------------------
watch_7 = Watch(python_script_3)
