# Dynamo graph InsertIntoSqlite.dyn (Dynamo 1.3.0.875)

categories = Categories("DuctCurves")
all_elements_of_category = ElementsOfCategory(categories)

# group: Get element parameters
id = Element.Id(all_elements_of_category)
string_from_object = FromObject(id)
code_block = CodeBlock { "Height"; "Width"; "Diameter"; "Length"; }
getParameterValueByName = Element.GetParameterValueByName(element=all_elements_of_category, parameterName=code_block.out0)
string_from_object_2 = FromObject(getParameterValueByName)
getParameterValueByName_2 = Element.GetParameterValueByName(element=all_elements_of_category, parameterName=code_block.out1)
string_from_object_3 = FromObject(getParameterValueByName_2)
getParameterValueByName_3 = Element.GetParameterValueByName(element=all_elements_of_category, parameterName=code_block.out2)
string_from_object_4 = FromObject(getParameterValueByName_3)
getParameterValueByName_4 = Element.GetParameterValueByName(element=all_elements_of_category, parameterName=code_block.out3)
string_from_object_5 = FromObject(getParameterValueByName_4)

total_elements = List.Count(all_elements_of_category)

# group: Get list of [element id, parameter, ...]
join = List.Join(string_from_object, string_from_object_2, string_from_object_3, string_from_object_4, string_from_object_5)
chop = List.Chop(list=join, lengths=total_elements)
code_block_2 = CodeBlock(list=chop) { list[0]; list[1]; list[2]; list[3]; list[4]; }
py_zips_lists = Python(IN[0]=code_block_2.out0, IN[1]=code_block_2.out1, IN[2]=code_block_2.out2, IN[3]=code_block_2.out3, IN[4]=code_block_2.out4)
# ---------- py_zips_lists.python (12 lines) ----------
import clr
clr.AddReference('ProtoGeometry')
from Autodesk.DesignScript.Geometry import *
#The inputs to this node will be stored as a list in the IN variables.
elementIds = IN[0]
Heights = IN[1]
Widths = IN[2]
Diameters = IN[3]
Lengths = IN[4]

#Assign your output to the OUT variable.
OUT = zip(elementIds, Heights, Widths, Diameters, Lengths)
# ----------------------------------------
watch = Watch(py_zips_lists)
watch_2 = Watch(chop)

# group: Create tableName as <Category>_<datetime.utcnow>
string_from_object_6 = FromObject(categories)
string = StringInput("_")
now = DateTime.Now()
string_from_object_7 = FromObject(now)
py_create_unix_timestamp = Python(IN[0]=string_from_object_7)
# ---------- py_create_unix_timestamp.python (10 lines) ----------
import sys
sys.path.append(r"C:\Program Files (x86)\IronPython 2.7\Lib")
from datetime import datetime
import time
import calendar

now = datetime.utcnow()
str_format = IN[0]

OUT = calendar.timegm(now.utctimetuple())
# ----------------------------------------
string_from_object_8 = FromObject(py_create_unix_timestamp)
concat = String.Concat(string_from_object_6, string, string_from_object_8)
watch_3 = Watch(py_create_unix_timestamp)
tableName = Watch(concat)

# group: Write to db
py_generate_sql_command = Python(IN[0]=concat, IN[2]=py_zips_lists)  # unwired: IN[1]
# ---------- py_generate_sql_command.python (28 lines) ----------
import clr
clr.AddReference('ProtoGeometry')
from Autodesk.DesignScript.Geometry import *
#The inputs to this node will be stored as a list in the IN variables.
tableName = IN[0]
listOfFields = IN[1]
listOfValues = IN[2]

#listOfValues = [["9999", "1", "3", "5", "7", "9", "11"], ["8888", "2", "4", "6", "8", "10", "12"]]
#tableName = "MechDucts"

# Create dictionary items with first value as key
dictionary = {e[0] : e[0:] for e in listOfValues}

dicString = ", ".join(listOfValues[0])

# Create SQL command
sqlCommand = ""
sqlCommand += "CREATE TABLE " + tableName + " (ElementId INTEGER, Height REAL, Width REAL, Diameter REAL, Length REAL, CONSTRAINT ElementPk PRIMARY KEY (ElementId));\n" + "BEGIN TRANSACTION; \n"

for item in enumerate(listOfValues):
    sqlCommand+=str("INSERT INTO " + tableName +
              "(ElementId, Height, Width, Diameter, Length) " +
              "VALUES (" + "".join(str(item[1]).translate(None, "[]")) + ");\n")
sqlCommand+="COMMIT;"

#Assign your output to the OUT variable.
OUT = sqlCommand
# ----------------------------------------
watch_4 = Watch(py_generate_sql_command)
file_path = Filename("..\..\..\..\..\..\Dev Lab\SeaDUG\Sandbox\SQLite Example\DB\Mechanical.db")
boolean = BoolSelector(true)
SQLite_Command = Database.Command.SQLite_Command(file_path, boolean, py_generate_sql_command)

# group: Get current table
boolean_2 = BoolSelector(true)
string_2 = StringInput("*")
selectFrom = Database.SQL.SelectFrom(string_2, concat)
SQLite_Query = Database.Query.SQLite_Query(file_path, boolean_2, selectFrom)
watch_5 = Watch(SQLite_Query)

boolean_3 = BoolSelector(true)
SQLite_Query_2 = Database.Query.SQLite_Query(file_path, boolean_3)  # unwired: arg2
string_3 = StringInput("*")
string_4 = StringInput("type='table'")
selectFromWhere = Database.SQL.SelectFromWhere(string_3, arg2=string_4)  # unwired: arg1
watch_6 = Watch(selectFromWhere)
selectFrom_2 = Database.SQL.SelectFrom(string_3, concat)
string_5 = StringInput("dbname.sqlite_master")
